# Grasshopper definition CW4.0_WP1_WIP.gh (Grasshopper 1.0.7)
# plug-ins: jSwan, Swiftlet, LunchBox

slider = Slider(150, range=1..1000)

series = Series(Start=Slider(1, range=0..1), Step=1, Count=10)
concat = Concatenate(FragmentA="p", FragmentB=series)

python = GhPythonScript(x=slider)  # -> out, a; inputs x: Int32; same code as python
cluster = Cluster(count=slider)  # -> genelist_a_2, genelist_b_2, genelist_c_2, C, genelist_g_2

width = Slider(20, range=0..100)
height = Slider(2, range=0..100)
priority = Slider(1, range=0..1)
length = Slider(100, range=0..100)
priority_2 = Slider(2, range=0..2)
length_2 = Slider(100, range=0..100)
width_2 = Slider(20, range=0..100)
height_2 = Slider(2, range=0..100)
merge = Merge(Data1=priority, Data2=length, Data3=width, Data4=height)
merge_2 = Merge(Data1=priority_2, Data2=length_2, Data3=width_2, Data4=height_2)
merge_3 = Merge(Data1="priority", Data2="length", Data3="height", Data4="width")
rejsonkv = SerializeKeysAndValues(Key=merge_3, Value=merge)
rejsonkv_2 = SerializeKeysAndValues(Key=merge_3, Value=merge_2)
rejsonkv_3 = SerializeKeysAndValues(Key=simplify(graft(concat)), Value=rejsonkv)  # -> flatten(JSON)
rejsonkv_4 = SerializeKeysAndValues(Key="parts", Value=rejsonkv_3)
rejsonkv_5 = SerializeKeysAndValues(Key="name", Value="Javid")
jmerge = MergeJson(SourceJson=rejsonkv_5, OverrideJson=rejsonkv_4)
panel = Panel(jmerge)

multiplication = Multiplication(A=cluster.genelist_a_2, B=cluster.genelist_b_2, C=cluster.genelist_c_2)
division = Division(A=multiplication, B=10000000)
division_2 = Division(A=cluster.genelist_g_2, B=1000)
division_3 = Division(A=division_2, B=division)

design_element_index = Slider(0, range=0..12)

# ---- group: GET data from DB
# Get API request from Database
# 25 ms
development_server = Panel("http://127.0.0.1:5000/residual_wood")
production_server = Panel("https://robotlab-residualwood.onrender.com/residual_wood")
get_request = Button()
dam = DataDam(DataA=design_element_index, DataB=production_server, DataC=get_request, BufferDelay=2500000, BufferMode=0)  # -> DataA, DataB, DataC
get = GETRequest(URL=dam.DataB)  # -> Status, Content, Response
dejson = DeserializeJson(JSON=get.Content, OutputsLocked=False)
dejson_2 = DeserializeJson(JSON=dejson, OutputsLocked=False)  # -> Color, Density, Height, Id, Info, Length, Price, Requirements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

# ----
milling_bit_radius = Slider(8, range=1..10)

# ---- group: DESIGN
brep = Brep([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])

# ----
bbox = BoundingBox(Content=brep, Plane=PlaneXY(0, 0, 0))  # -> Box, Box_2

# ---- group: Lenght of pieces
debrep = DeconstructBrep(Brep=bbox.Box)  # -> Faces, Edges, Vertices
len = Length(Curve=debrep.Edges)
cset = CreateSet(List=len)  # -> Set, Map
sort = SortList(Keys=cset.Set)  # -> Keys, ValuesA

# ---- group: GET data from DB
# Get API request from Database
panel_2 = Panel("https://wood-db.onrender.com/residual_wood")
get_2 = GETRequest(URL=panel_2)  # -> Status, Content, Response; disabled
dejson_3 = DeserializeJson(JSON=get_2.Content, OutputsLocked=False)
dejson_4 = DeserializeJson(JSON=dejson_3, OutputsLocked=False)  # -> Color, Density, Height, Id, Info, Length, Price, Requirements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

# ---- group: Lenght of pieces / Lengths
item = ListItem(List=reverse(sort.Keys), Index=0, Wrap=True)  # -> flatten(Item)

# ---- group: Lenght of pieces / Width
item_2 = ListItem(List=reverse(sort.Keys), Index=1, Wrap=True)  # -> flatten(Item)

# ---- group: Lenght of pieces / Thickness
item_3 = ListItem(List=reverse(sort.Keys), Index=2, Wrap=True)  # -> flatten(Item)

# ----
number_slider = Slider(6, range=0..10)
srf = Surface(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)

# ---- group: Pre-selection from width / Width of Design element
item_4 = ListItem(List=item_2, Index=design_element_index, Wrap=True)

# ----
diagrid = DiagridStructure(Surface=srf, UDivisions=number_slider, VDivisions=number_slider, Type=True)  # -> StructureLines, StructureNodes
item_5 = ListItem(List=dejson_3, Index=0, Wrap=True)  # -> Item1, Item
panel_3 = Panel(item_5.Item1)

# ---- group: INITIAL DESIGN
crv = Curve([<curve referenced from the Rhino model> x2])

# ----
# Selection from Database based on Nearest Length
len_2 = Length(Curve=crv)
data = Data(len_2)
sort_2 = SortList(Keys=data, ValuesA=crv)  # -> Keys, ValuesA
python_2 = GhPythonScript(design_lengths=sort_2.Keys, database_lengths=dejson_4.Length)  # -> nearest_lengths; inputs design_lengths: list, database_lengths: list
# ---------- python_2: Python ----------
__author__ = "Javid Jooshesh, j.jooshesh@hva.nl"
__version__ = "v1"


def find_closest_members(array1, array2):
    closest_members = []
    for value in array1:
        nearest_value = min(array2, key=lambda x: abs(x - value))
        closest_members.append(nearest_value)
    return closest_members
    

nearest_lengths = find_closest_members(design_lengths, database_lengths)
# ---------- end python_2 ----------
keysearch = KeyValueSearch(Keys=dejson_4.Length, Values=dejson_4.Id, Search=python_2)
index = ItemIndex(List=dejson_4.Id, Item=keysearch)
item_6 = ListItem(List=dejson_3, Index=index, Wrap=True)
dejson_5 = DeserializeJson(JSON=item_6, OutputsLocked=False)  # -> Color, Density, Height, Id, Info, Length, Price, Requirements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

# ---- group: Visualizing design
addition = Addition(A=design_element_index, B=1)
series_2 = Series(Start=0, Step=1, Count=addition)  # -> flatten(Series)
cull_i = CullIndex(List=flatten(brep), Indices=series_2, Wrap=True)
preview = CustomPreview(Geometry=cull_i, Material=ColourSwatch(SwatchColor=RGBA(0, 225, 255, 124)))

# ---- group: Length of Design element
item_7 = ListItem(List=item, Index=design_element_index, Wrap=True)

# ---- group: Tree mask
concat_2 = Concatenate(FragmentA="{", FragmentB=design_element_index, FragmentC=";*}")

# ----
# Wood from Database
number_slider_2 = Slider(242, range=0..1200)
lng = ListLength(List=dejson_5.Id)
pt = ConstructPoint(XCoordinate=0, YCoordinate=expr("x*2", Slider(100, range=0..100)), ZCoordinate=0)
series_3 = Series(Start=0, Step=number_slider_2, Count=lng)
Y = UnitY(Factor=series_3)
move = Move(Geometry=pt, Motion=Y)  # -> Geometry, Transform
rectangle = Rectangle(Plane=move.Geometry, XSize=dejson_5.Length, YSize=dejson_5.Width, Radius=0)  # -> Rectangle, Length
boxrec = BoxRectangle(Rectangle=rectangle.Rectangle, Height=dejson_5.Height)

# ----
# To Rollback:
# Switch the index with the series
number_slider_3 = Slider(20, range=0..100)
series_4 = Series(Start=1, Step=1, Count=number_slider_3)

length_tolerance = Slider(10, range=0..10)
ratio = Slider(8.895, range=0..10)
python_3 = GhPythonScript(
    wood_from_db=boxrec,
    design_boundary=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,
    heights=dejson_5.Height,
    line_segment=crv,
    tolerane=length_tolerance,
    ratio_tolerance=ratio)  # -> all_blocks, normal, linear_indecies, ratios, available_length; inputs wood_from_db: list, heights: list, line_segment: list
# ---------- python_3: Python ----------
"""__author__ = "Javid Jooshesh, j.jooshesh@hva.nl"
__version__ = "v1"
"""
import ghpythonlib.treehelpers as th
import rhinoscriptsyntax as rs
import Grasshopper.Kernel.Data as ghp
import Grasshopper.Kernel.Geometry.Plane as gh_plane


class Blocks:
    """_Class representing the wood plank geometries from the database_
    Attributes:
        source (DataTree[Breps]) : The list of box breps as a Grasshopper
            datatree
    Methods:
        explode_polysrf: ...
        explode_srf: ...
        get_block_length: ...
        get_block_width: ...
    """

    def __init__(self, source):
        """_Constructor of the class_
        Args:
            source (DataTree[objectid]) : The list of box breps
                as a Grasshopper datatree
        """

        self.source = source

    def __str__(self):
        return "A Class to Represent the Functions of " \
               "Form-Fitting for the Circular Wood Blocks from Scanned Database"

    def explode_polysrf(self):
        """Explode a brep object into the NURBS untrimmed surfaces"""
        p = []
        for i in range(len(self.source)):
            trimmed_srf = rs.ExplodePolysurfaces(self.source[i])
            blocks = []
            for srf in trimmed_srf:
                blocks.append(srf)
            p.append(blocks)
        data = th.list_to_tree(p, source=[0])
        return data

    def explode_srf(self):
        """Explode the surface into line segments"""
        p = []
        listed_tree = th.tree_to_list(self.explode_polysrf())
        curve = None
        for i in range(len(listed_tree)):
            curve_segments = []
            for j in range(len(listed_tree[i])):
                curve = rs.DuplicateEdgeCurves(listed_tree[i][j])
                curve_segments.append(curve)
            p.append(curve_segments)
        data = th.list_to_tree(p, source=[0])
        return data

    def get_block_length(self, position=2):
        """Return the length of the block as float. BigO(n^2)
            (not the most efficient way but it works for now)
        """
        list_of_lengths = []
        curves = th.tree_to_list(self.explode_srf())
        for i in range(len(curves)):
            blocks = []
            for j in range(len(curves[i])):
                lengths = []
                for k in range(len(curves[i][j])):
                    l = rs.CurveLength(curves[i][j][k])
                    lengths.append(l)
            blocks.append(sorted(lengths)[position])
            list_of_lengths.append(blocks)

        lengths_data_tree = th.list_to_tree(list_of_lengths, source=[0])
        return lengths_data_tree

    def get_block_width(self, position=1):
        """Return the width of the block as float"""
        widths = self.get_block_length(position=position)
        return widths
        
    def get_block_height(self, position=3):
        heights = self.get_block_length(position=position)
        return heights
    
    
class DesignModel:
    """_Class representing the design object and methods to fit the wood planks
    that are varaible in dimensions, within the boundary of the design_

    Attributes:
        design_region (DesignRegion) : The boundary of design
        blocks (Blocks) : The box breps representing the wood planks from the
            database
    Methods:
        orient: ...
        fit_blocks: ...
    """

    def __init__(self, design_region, blocks, heights, srf_index):
        """_Constructor method_"""

        self.region = DesignRegion(design_region, 0)
        self.srf_index = srf_index
        self.blocks = Blocks(blocks)
        self.blocks_length = self.blocks.get_block_length()
        self.blocks_width = self.blocks.get_block_width()
        self.blocks_height = heights
        self.index_list = []
        self.selection = []
        self.flatten_values()
    
    def flatten_values(self):
        """_Flatten the Length, Width and Height values_"""
        
        flatten_path_width = ghp.GH_Path(0)
        self.blocks_width.Flatten(flatten_path_width)
        flatten_path_length = ghp.GH_Path(0)
        self.blocks_length.Flatten(flatten_path_length)
        flatten_path_height = ghp.GH_Path(0)
        self.blocks_length.Flatten(flatten_path_height)


class DesignRegion:
    def __init__(self, brep, index):
        self.brep = brep
        self.index = index

    def explode(self):
        return rs.ExplodePolysurfaces(self.brep)

    def select_lowest_face(self):
        """Sort the faces of the Brep according to lowest `z` value of the
            centroids
        """
        exploded_surfaces = self.explode()
        z_coords = list()
        lowest_srf = None
        for i in range(len(exploded_surfaces)):
            centriod = rs.SurfaceAreaCentroid(exploded_surfaces[i])
            z_values = centriod[0][2]
            z_coords.append(z_values)
            if z_values == min(z_coords):
                lowest_srf = exploded_surfaces[i]
        return lowest_srf
    
    def select_custom_face(self, selected_index):
        exploded_surfaces = self.explode()
        for index, item in enumerate(exploded_surfaces):
            if index == selected_index:
                return item
    
    def find_edge(self, edge_index, surface_index):
        """Get the edge to populate blocks across within the design boundary"""
        selected_face = self.select_custom_face(surface_index)
        for index, item in enumerate(rs.DuplicateEdgeCurves(selected_face)):
            if index == edge_index:
                return item
                

class LinearElement:
    def __init__(self, line, blocks, used_blocks_index):
        self.blocks = Blocks(blocks)
        self.line = []
        for l in line:
            self.line.append(l)

        self.length = [rs.CurveLength(l) for l in self.line]
        self.start_point = [rs.CurvePoints(l)[0] for l in self.line]
        self.end_point = [rs.CurvePoints(l)[1] for l in self.line]
        self.normal_axis = []
        self.normal = []

        for i in range(len(self.start_point)):
            self.normal_axis.append(rs.VectorCreate(self.end_point[i], self.start_point[i]))
            self.normal.append(rs.PlaneFromNormal(self.start_point[i], self.normal_axis[i]))
        self.selection = []
        self.index_list = []
        self.used_index = used_blocks_index
        self.base = None
            
    def filter_used_blocks(self):
        unused_indexes = []
        for index in range(len(self.blocks.source)):
            if index in self.used_index:
                continue
            unused_indexes.append(index)
        return unused_indexes
    
    def pick_element(self, available_length, tolerane, r_tolerance):
        """_Select elements to build linear parts. Check the ratio
            of width and height as well_"""

        blocks_dict = {}    # blocks_dict = {lengths: blocks}
        lengths = th.tree_to_list(self.blocks.get_block_length())   # Python list
        
        filtered_blocks = self.filter_used_blocks()
        list_of_available_blocks = [self.blocks.source[i] for i in filtered_blocks]

        self.base = [rs.ExplodePolysurfaces(b)[1] for b in list_of_available_blocks]
        heights = [rs.SurfaceDomain(b, 1)[1] for b in self.base]
        widths = [rs.SurfaceDomain(b, 0)[1] for b in self.base]

        ratio = [widths[i] / heights[i] for i in range(len(heights))]

        for i in range(len(list_of_available_blocks)):
            if 0.5 < ratio[i] < r_tolerance:
                length = lengths[i][0]
                blocks_dict[length] = list_of_available_blocks[i]

        length_range = [range(int(l - (tolerane * 2)), int(l + (tolerane * 2))) for l in available_length]
        print(blocks_dict)
        block_list = []
        for i in range(len(length_range)):
            inner = []
            for key, value in blocks_dict.items():
                if int(key) in length_range[i]:
                    inner.append((value, key))
                    
                    self.selection.append(value)
                    del blocks_dict[key]
                    for index, item in enumerate(list_of_available_blocks):
                        if item == value:
                            self.index_list.append(index)
            block_list.append(inner)
#            print(inner)
        return th.list_to_tree(block_list[:], source=[0])


def main():
    global ratios
    global all_blocks
    global normal
    global linear_indecies
    global available_length
    
    test = DesignModel(design_boundary, wood_from_db, heights, 5)
    print(test)
    all_blocks = test.blocks.source
    packed_indecies = test.index_list
    packed_selection = test.selection

    normal = []
    li = []

    a = LinearElement(line_segment, wood_from_db, packed_indecies)
    available_length = []
        
    for i in line_segment:
        available_length.append(rs.CurveLength(i))

    ratios = a.pick_element(available_length, tolerane, ratio_tolerance)
    normal.append(a.normal)
    li.append(a.index_list)

    linear_indecies = th.list_to_tree(li, source=[0])
    linear_selection = a.selection
    normal = th.list_to_tree(normal, source=[0])


if __name__ == "__main__":
    main()
# ---------- end python_3 ----------

sort_3 = SortList(Keys=dejson_5.Id, ValuesA=boxrec)  # -> Keys, ValuesA

lng_2 = ListLength(List=crv)
series_5 = Series(Start=0, Step=1, Count=lng_2)
item_8 = ListItem(List=python_3.linear_indecies, Index=series_5, Wrap=True)

cset_2 = CreateSet(List=item_8)  # -> Set, Map
lng_3 = ListLength(List=cset_2.Set)

panel_4 = Panel("""length
width
height
weight
density
timestamp
color
reserved
reservation_name
reservation_time
requirements
source
price
info
type""")
cluster_2 = Cluster_2(data=cluster.genelist_g_2)
flip = FlipMatrix(Data=cluster_2)
rejsonkv_6 = SerializeKeysAndValues(Key=panel_4, Value=flip)  # -> flatten(JSON)
get_string = GetString(rejsonkv_6, AtLeast=1, AtMost=2147483647)
ctb = CreateTextBody(
    Content=get_string,
    IsHtmlChecked=False,
    IsJavascriptChecked=False,
    IsJsonChecked=True,
    IsTextChecked=False,
    IsXmlChecked=False)

# ----
# Dont press this if you don't have new DATA to be added to the database
post_request = Button()
panel_5 = Panel("http://127.0.0.1:5000/residual_wood")
dam_2 = DataDam(DataA=production_server, DataB=post_request, DataC=ctb, BufferDelay=10000000, BufferMode=0)  # -> DataA, DataB, DataC

# ---- group: POST data to DB
# Post API call  to Database
# DB Schema updated
entwine = Entwine(
    Branch00=cluster.genelist_a_2,
    Branch01=cluster.genelist_b_2,
    Branch02=cluster.genelist_c_2,
    Branch03=cluster.genelist_g_2,
    Branch04=division_3,
    Branch05=cluster.C,
    Branch06=python.a,
    FlattenInputs=True)  # -> simplify(Result)
flip_2 = FlipMatrix(Data=entwine)
panel_6 = Panel("""id
length
width
height
weight
density
color
timestamp
info
requirements
reserved
reservation_name
reservation_time
source
price""")
rejsonkv_7 = SerializeKeysAndValues(Key=panel_6, Value=flip)  # -> flatten(JSON)
get_string_2 = GetString(rejsonkv_7, AtLeast=1, AtMost=2147483647)
ctb_2 = CreateTextBody(
    Content=get_string_2,
    IsHtmlChecked=False,
    IsJavascriptChecked=False,
    IsJsonChecked=True,
    IsTextChecked=False,
    IsXmlChecked=False)
post = POSTRequest(URL="https://wood-db.onrender.com/residual_wood", Body=ctb_2)  # -> Status, Content, Response; disabled

# ----
post_2 = POSTRequest(URL=dam_2.DataA, Body=dam_2.DataC)  # -> Status, Content, Response; disabled

# ---- group: Data to rollback changes
data_2 = Data(graft(ctb))

# ----
panel_7 = Panel(data_2)

# ---- group: API call to remove the used wood based on ID
# DELETE from Database
panel_8 = Panel("https://wood-db.onrender.com/residual_wood")

# ---- group: VISUAL
lng_4 = ListLength(List=dejson_2.Id)
rectangle_2 = Rectangle(Plane=PlaneXY(0, 0, 0), XSize=dejson_2.Length, YSize=dejson_2.Width, Radius=0)  # -> Rectangle, Length
series_6 = Series(Start=0, Step=Slider(171, range=0..200), Count=lng_4)
boxrec_2 = BoxRectangle(Rectangle=rectangle_2.Rectangle, Heights=dejson_2.Height)
Y_2 = UnitY(Factor=series_6)
move_2 = Move(Geometry=boxrec_2, Motion=Y_2)  # -> Geometry, Transform
preview_2 = CustomPreview(Geometry=move_2.Geometry, Material=dejson_2.Color)

# ---- group: Pre-selection from width
smaller = SmallerThan(FirstNumber=item_4, SecondNumber=dejson_2.Width)  # -> SmallerThan, OrEqualTo
cull = CullPattern(List=move_2.Geometry, CullPattern=smaller.OrEqualTo)
cull_2 = CullPattern(List=dejson_2.Id, CullPattern=smaller.OrEqualTo)

# ----
cull_3 = CullPattern(List=dejson_2.Length, CullPattern=smaller.OrEqualTo)
python_4 = GhPythonScript(design_elements=item, database_elements=cull_3, bit_diameter=milling_bit_radius)  # -> guide, simplify(index_list); inputs design_elements: list, database_elements: list
# ---------- python_4: Python ----------
"""__author__ = "Javid Jooshesh, j.jooshesh@hva.nl"
__version__ = "v1"
"""

import rhinoscriptsyntax as rs
import Grasshopper.DataTree as dt
import ghpythonlib.treehelpers as th

pairs = []

for i in range(len(database_elements)):
    for j in range(len(design_elements)):
        if database_elements[i] / (design_elements[j] + bit_diameter) >= 1:
            pairs.append(
                (i, j, float(
                    database_elements[i] / (design_elements[j] + bit_diameter)
                )
            )
        )
            
dic = {}

# Hashtable
for i in range(len(design_elements)):
    dic[i] = []
    
for i in range(len(pairs)):
    if pairs[i][1] in dic.keys():
        dic[pairs[i][1]].append(
            (pairs[i][0], pairs[i][2])
        ) if pairs[i][2] >= 1 else None

index_list = th.list_to_tree(
    [
        dic[i] for i in range(len(design_elements))
    ], source=[0]
)

msg = "Database Index: {0}, Design Element Index: {1}, Amounts per Element: {2}"
for i in range(len(pairs)):
    a = pairs[i][0]
    b = pairs[i][1]
    c = pairs[i][2]
    print(msg.format(a, b, c))
# ---------- end python_4 ----------

# ---- group: VISUAL (continued)
volume = Volume(Geometry=cull)  # -> Volume, Centroid
debrep_2 = DeconstructBrep(Brep=cull)  # -> Faces, Edges, Vertices
linedim = LineDimension(Line=debrep_2.Edges, Text="{0:0.00}", Size=Slider(10, range=0..10))
tag = TextTag(Location=volume.Centroid, Text=cull_2, Colour="#000000")

# ----
split = SplitTree(Data=python_4.index_list, Masks=flatten(concat_2))  # -> Positive, Negative
info = ListItem(List=split.Positive, Index=0, Wrap=True)  # -> Item, Item1
panel_9 = Panel(python_4.guide)

# ---- group: DB elements (geometries)
data_3 = Data(cull)

# ----
item_9 = ListItem(List=brep, Index=design_element_index, Wrap=True)
item_10 = ListItem(List=data_3, Index=flatten(info.Item), Wrap=True)
item_11 = ListItem(List=bbox.Box, Index=design_element_index, Wrap=True)

# ---- group: Amounts per Elements
data_4 = Data(info.Item1)

# ----
panel_10 = Panel(data_4)
item_12 = ListItem(List=cull_3, Index=flatten(info.Item), Wrap=True)

# ---- group: Pairs (Design & DB elements)
entwine_2 = Entwine(Branch00=item_9, Branch01=item_10, FlattenInputs=True)

# ----
int = Integer(data_4)

# ---- group: Database Index
data_5 = Data(info.Item)

# ----
# Take the index of elements in
# the database, and check per every
# design element indecies. Compare the
# length of each part, and evaluate how many parts are possible to get
# from each element in the database. (APE)
# 
# Create a Queue of elements to be used from the database.
# Once each element is dequeued from the task, the remaining length of the
# database element will be updated as it's original length will be deducted
# by the length of the design element which was cutout from it.
python_5 = GhPythonScript(
    des_index=design_element_index,
    lengths=item_7,
    db_index=flatten(info.Item),
    remained_lengths=item_12,
    ape=flatten(int),
    filtered_widths_indecies=cull_2)  # -> remaining_length, db_index_to_update; inputs des_index: list of Int32, lengths: list, db_index: list of Int32, remained_lengths: list, ape: list of Int32, filtered_widths_indecies: list
# ---------- python_5: Python ----------
"""
__Matching Algorithm__
__author__ = "Javid Jooshesh, j.jooshesh@hva.nl"
__version__ = "v1"
"""

        
class Node:
    def __init__(self, value):
        self.value = value
        self.next = None
        
        
class Queue:
    """_A class representing the Queue data structure based on the FIFO 
        (first in first out) principle_"""
            
    def __init__(self, value):
        """_Init method of the class_"""
                
        new_node = Node(value)
        self.first = new_node
        self.last = new_node
        self.length = 1
        
    def print_queue(self):
        """_A method to print the nodes of the queue_"""
                
        current = self.first
        while current:
            print(current.value)
            current = current.next
        
    def enqueue(self, value):
        """_Add a node to the queue_"""
                
        new_node = Node(value)
        if self.length == 0:
            self.first = new_node
            self.last = new_node
        else:
            self.last.next = new_node
            self.last = new_node
        self.length += 1
        
    def dequeue(self):
        """_Remove a node from the queue_"""
                
        if self.length == 0:
            return None
        current = self.first
        if self.length == 1:
            self.first = None
            self.last = None
        else:
            self.first = self.first.next
            current.next = None
        self.length -= 1
        return current
        
        
def update_length(subtracting_length, index):
    """ Update the length of part in the database via subtracting its length
    from the length of the design part
    """
    
    global remained_lengths
    try:
        remained_lengths[index] -= subtracting_length
        return remained_lengths[index]
    except:
        msg = "### -----> Index is not in the list <----- ###"
        print(msg)
        return -1
        
def organize(param_1, param_2, param_3):
    """ Organize the given data as parameters. This function is used to
        organize the elements with the criteria of length and the factor of 
        APE (Amount Per Element). 
        
        param_1: A set from the list of APE as inputs
        param_2: List of indecies of usable elements from the database
        param_3: Remained length of the usable elements in the database at the
            index of `param_2`
        
        returns: Dictionary of the data organized in the following way:
                   {
                param_1: {
                    'index_list': [param_2],
                    'remained_lengths': [param_3]
                }
            }
    """
    hashtable = dict()
    FIRST_ARG = 0
    SECOND_ARG = 1
    data = zip(param_1, param_2, param_3)
            
    for i in range(len(param_1)):
        hashtable[param_1[i]] = {'index_list': [], 'remained_lengths': []}
                
    for i in range(len(data)):
        if data[i][FIRST_ARG] in hashtable.keys():
            hashtable[data[i][FIRST_ARG]]['index_list'].append(data[i][SECOND_ARG])
            hashtable[data[i][FIRST_ARG]]['remained_lengths'].append(param_3[i])
                    
    return hashtable
        

def main():
    global ape
    global db_index
    global remained_lengths
    global lengths
    global design_elements_index
    global db_index_to_update
    global des_index
    global filtered_widths_indecies
    global selection_index
    
    LAST_INDEX = -1
    FIRST_INDEX = 0
    
    data = organize(ape, db_index, remained_lengths)
    filtered_lengths_indecies = [data[key]['index_list'] for key in data]
    
    for key in data:
        # See whats in the data
        print("{0}: {1}".format(key, data[key]))
    print("----------------------------")
    
    queue = Queue(None)
    ape_as_key_list = sorted(set(ape))
    print(ape_as_key_list)
    if queue.first.value is not None:
        queue.print_queue()
    
    node = []
    
    for key, value in data.items():
        if key == ape_as_key_list[LAST_INDEX]:
            for index, item in enumerate(value['index_list']):
                if index == FIRST_INDEX:
                    # Add the item and remained_lengths at the same index
                    # to the node as a tuple
                    node.append((item, value['remained_lengths'][index]))
                    
                    if queue.first.value is None:
                        queue.dequeue()
                    queue.enqueue(node[FIRST_INDEX])

    updated_length = 0
    print(node)
    # Design Element Index
    dei = []
    # For now just working with one element. Later can be a list of lengths 
    for i in range(len(lengths)):
        for index, item in enumerate(db_index):
            if item == node[FIRST_INDEX][0]:
                # Update the length by subtracting the design element length 
                # from the database element length
                updated_length = update_length(lengths[i], index)
                dei.append(index)

        lengths.remove(lengths[i])
    queue.print_queue()
    db_index_to_update = node[FIRST_INDEX][0]
    
    design_elements_index = dei 
    return updated_length
    
    
if __name__ == "__main__":
    remaining_length = main()
# ---------- end python_5 ----------

panel_11 = Panel([data_5, int])
item_13 = ListItem(Width_filtered_indecies=cull_2, Index=python_5.db_index_to_update, Wrap=True)

# ---- group: Update Database
id = Slider(3, range=0..10)
test = Slider(1015, range=0..10000)
panel_12 = Panel("id")
item_14 = ListItem(List=dejson, Index=expr("x - 1", series_4), Wrap=True)
dejsonkv = DeserializeKeysAndValues(JSON=item_14)  # -> Key, Value
cull_i_2 = CullIndex(List=dejsonkv.Key, Indices=id, Wrap=True)
cull_i_3 = CullIndex(List=dejsonkv.Value, Indices=id, Wrap=True)
key = Panel("length")
keysearch_2 = KeyValueSearch(Keys=cull_i_2, Values=cull_i_3, Search=key)
# To Rollback:
# Switch the BODY with DATA output
index_2 = ItemIndex(List=cull_i_3, Item=keysearch_2)
production_server_2 = Panel("https://robotlab-residualwood.onrender.com/residual_wood/")
data_to_update = Panel(python_5.remaining_length)
replace = ReplaceItems(List=cull_i_3, Item=python_5.remaining_length, Indices=index_2, Wrap=False)
rejsonkv_8 = SerializeKeysAndValues(Key=cull_i_2, Value=replace)
development_server_2 = Panel("http://127.0.0.1:5000/residual_wood/")
get_string_3 = GetString(rejsonkv_8, AtLeast=1, AtMost=2147483647)
ctb_3 = CreateTextBody(
    Content=get_string_3,
    IsHtmlChecked=False,
    IsJavascriptChecked=False,
    IsJsonChecked=True,
    IsTextChecked=False,
    IsXmlChecked=False)
concat_3 = Concatenate(FragmentA=production_server_2, FragmentB=series_4)  # -> graft(Result)

# ----
part_length = Slider(334, range=0..1000)
item_15 = ListItem(List=cull, Index=python_5.db_index_to_update, Wrap=True)
bbox_2 = BoundingBox(Content=item_15, Plane=PlaneXY(0, 0, 0))  # -> Box, Box_2
debrep_3 = DeconstructBrep(Brep=bbox_2.Box)  # -> Faces, Edges, Vertices
item_16 = ListItem(List=debrep_3.Edges, Index=0, Wrap=True)
subtraction = Subtraction(A=part_length, B=milling_bit_radius)
divlength = DivideLength(Curve=item_16, Length=part_length)  # -> Points, Tangents, Parameters
len_3 = Length(Curve=item_16)
addition_2 = Addition(A=part_length, B=milling_bit_radius)
Y_3 = UnitY(Factor=1)
division_4 = Division(A=len_3, B=addition_2)
line = LineSDL(Start=divlength.Points, Direction=Y_3, Length=Slider(166, range=0..200))
panel_13 = Panel(division_4)
Z = UnitZ(Factor=Slider(100, range=0..100))
extr = Extrude(Base=line, Direction=Z)
X = UnitX(Factor=milling_bit_radius)
extr_2 = Extrude(Base=extr, Direction=X)
sdiff = SolidDifference(BrepsA=graft(bbox_2.Box), BrepsB=extr_2)  # -> simplify(Result)
bang = ExplodeTree(Data=sdiff)
debrep_4 = DeconstructBrep(Brep=bang)  # -> Faces, Edges, Vertices
len_4 = Length(Curve=debrep_4.Edges)
cset_3 = CreateSet(List=len_4)  # -> Set, Map
sort_4 = SortList(Keys=cset_3.Set)  # -> reverse(Keys), ValuesA
item_17 = ListItem(List=sort_4.Keys, Index=0, Wrap=True)
int_2 = Integer(item_17)
equals = Equality(FirstNumber=flatten(int_2), SecondNumber=subtraction)  # -> Equality, Inequality
cull_4 = CullPattern(List=bang, CullPattern=equals.Equality)

# ----
# 50 ms
# Once ready, click the Datadam
# to update the database
dam_3 = DataDam(DataB=concat_3, DataA=data_2, BufferDelay=5000000, BufferMode=0)  # -> DataB, DataA
put = PUTRequest(URL=dam_3.DataB, Body=dam_3.DataA)  # -> Status, Content, Response
http_response = Panel(put.Response)

panel_14 = Panel(concat_3)

clean = CleanTree(RemoveNulls=True, RemoveInvalid=True, RemoveEmpty=invert(False), Tree=simplify(python_3.ratios))
data_6 = Data(sort_2.ValuesA)
item_18 = ListItem(List=clean, Index=0, Wrap=True)  # -> flatten(Item), flatten(Item1)
sort_5 = SortList(Lengths=item_18.Item1, ValuesBlocks=item_18.Item)  # -> Sorted_lengths, ValuesBlocks
sort_6 = SortList(Keys=python_3.available_length)  # -> Keys, ValuesA

# ---- group: ANALYTICS
eval = EvaluateCurve(Curve=reparameterize(data_6), Parameter=Slider(0.4, range=0..1))  # -> Point, Tangent, Angle
midpt = CurveMiddle(Curve=data_6)
move_3 = Move(Geometry=eval.Point, Motion=Vector(0, 0, 10))  # -> Geometry, Transform
sort_7 = SortList(Keys=sort_6.Keys, ValuesA=midpt)  # -> Keys, ValuesA
python_6 = GhPythonScript(anchor=sort_6.Keys, data=sort_5.Sorted_lengths)  # -> a; inputs anchor: list, data: list
# ---------- python_6: Python ----------
"""_Analitics_"""

def analyze(anchor, data):

    values = tuple(zip(anchor, data))
    diff = [values[i][1] - values[i][0] for i in range(len(anchor))]
    
    percentages = [
            "% " + str(round((diff[i] / anchor[i]) * 100, 2))
            for i in range(len(anchor))
        ]
    return percentages

a = analyze(anchor, data)
# ---------- end python_6 ----------
yz = YZPlane(Origin=sort_7.ValuesA)
data_7 = Data(item_6)
txt = Text(data_7)
tag_2 = TextTag(Location=yz, Text=python_6, Colour=ColourSwatch(SwatchColor=RGB(255, 255, 255)))
yz_2 = YZPlane(Origin=move_3.Geometry)
tag_3 = TextTag3D(
    Location=yz_2,
    Text=txt,
    Size=Slider(1.646, range=0..10),
    Colour=ColourSwatch(SwatchColor=RGB(0, 255, 229)),
    Justification=7)

# ---- group: Find closest lengths
python_7 = GhPythonScript(design_lengths=sort_6.Keys, database_lengths=item_18.Item1)  # -> nearest_lengths; inputs design_lengths: list, database_lengths: list; same code as python_2

# ----
keysearch_3 = KeyValueSearch(Keys=sort_5.Sorted_lengths, Values=sort_5.ValuesBlocks, Search=python_7)
index_3 = ItemIndex(List=python_3.all_blocks, Item=keysearch_3)

data_8 = Data(keysearch_3)
debrep_5 = DeconstructBrep(Brep=data_8)  # -> Faces, Edges, Vertices
item_19 = ListItem(List=debrep_5.Faces, Index=0, Wrap=True)  # -> Item, Item1
md_slider = MDSlider(
    SliderMode=0,
    slider_value=Point(0.5010223389, 0.5010242462, 0.5),
    x_domain=Domain(0, 1),
    y_domain=Domain(0, 1),
    z_domain=Domain(0, 1))
data_9 = Data(item_19.Item1)
evalsrf = EvaluateSurface(Surface=reparameterize(data_9), Point=md_slider)  # -> Point, Normal, UDirection, VDirection, Frame
pflip = FlipPlane(Plane=data_6, ReverseX=False, ReverseY=False, SwapAxes=True)
prot = RotatePlane(Plane=pflip, Angle=degrees(Slider(90, range=-90..90)))
orient = Orient(Geometry=data_8, Source=flatten(evalsrf.Frame), Target=prot)  # -> Geometry, Transform

lng_5 = ListLength(List=orient.Geometry)
min = Minimum(A=lng_3, B=lng_5)
series_7 = Series(Start=0, Step=1, Count=min)
item_20 = ListItem(List=orient.Geometry, Index=series_7, Wrap=True)
replace_2 = ReplaceItems(List=python_3.all_blocks, Item=item_20, Indices=cset_2.Set, Wrap=False)
preview_3 = CustomPreview(Geometry=replace_2, Material=cluster.C)

# ---- group: OUTPUT TO BAKE
geo = Geometry(orient.Geometry)

# ----
preview_4 = CustomPreview(Geometry=geo, Material=cluster.C)

# ---- group: API call to remove the used wood based on ID (continued)
item_21 = ListItem(List=dejson_5.Id, Index=index_3, Wrap=True)

# ---- group: API call to remove the used wood based on ID / Removed Indecies
data_10 = Data(item_21)

# ---- group: API call to remove the used wood based on ID (continued)
concat_4 = Concatenate(FragmentA=panel_8, FragmentB="/", FragmentA_2=data_10)
delete = DELETERequest(URL=concat_4)  # -> Status, Content, Response; disabled
panel_15 = Panel(delete.Response)

# ==== cluster Cluster
count = ClusterInput()

vb = VBScript(genelist="GeneList D", count=count)  # -> out, A
# ---------- vb: VB ----------
    For Each obj As IGH_DocumentObject In owner.OnPingDocument().Objects
      If (obj.ComponentGuid <> New Guid("{21553c44-ea62-475e-a8bb-62b2a3ee5ca5}")) Then Continue For
      If (obj.NickName Like genelist) Then
        CallByName(obj, "Count", CallType.Set, count)
        'CallByName(obj, "ExpireSolution", CallType.Method, False)
        Return
      End If
    Next

    Print("No matching Gene list object found")
# ---------- end vb ----------
vb_2 = VBScript(genelist="GeneList E", count=count)  # -> out, A; same code as vb
vb_3 = VBScript(genelist="GeneList F", count=count)  # -> out, A; same code as vb
vb_4 = VBScript(genelist="GeneList G", count=count)  # -> out, A; same code as vb
genelist_d = GeneList(
    Decimals=2,
    Maximum=255,
    Minimum=200,
    Value=[249.6870825, 227.159727, 220.7125882, 221.879463, 240.3877779, 247.7977078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])
genelist_e = GeneList(
    Decimals=2,
    Maximum=140,
    Minimum=120,
    Value=[123.301908, 126.2742014, 136.988057, 120.8476593, 139.8469819, 137.5064603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])
genelist_f = GeneList(
    Decimals=2,
    Maximum=90,
    Minimum=20,
    Value=[47.66573956, 64.54453612, 31.81359346, 80.80078899, 53.74216505, 67.76083834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])
genelist_g = GeneList(
    Decimals=2,
    Maximum=1000,
    Minimum=120,
    Value=[449.58535, 864.1659569, 128.0886553, 422.1313001, 285.0884081, 694.9051328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])
rgb = ColourRGB(Alpha=150, Red=genelist_d, Green=genelist_e, Blue=genelist_f)

vb_5 = VBScript(genelist="GeneList B", count=count)  # -> out, A; same code as vb
vb_6 = VBScript(genelist="GeneList A", count=count)  # -> out, A; same code as vb
vb_7 = VBScript(genelist="GeneList C", count=count)  # -> out, A; same code as vb
genelist_g_2 = ClusterOutput(genelist_g)

genelist_b = GeneList(
    Decimals=2,
    Maximum=25,
    Minimum=10,
    Value=[12.59518988, 16.61877447, 15.3142289, 23.44315202, 20.79544497, 15.52627439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])
genelist_a = GeneList(
    Decimals=2,
    Maximum=35,
    Minimum=30,
    Value=[33.88890474, 34.71611187, 30.6836495, 30.45055322, 32.85169996, 30.87290662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])
genelist_c = GeneList(
    Decimals=2,
    Maximum=3,
    Minimum=2,
    Value=[2.357290426, 2.185102099, 2.981203596, 2.288344855, 2.073907413, 2.381113439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])

C = ClusterOutput(rgb)
genelist_b_2 = ClusterOutput(genelist_b)
genelist_a_2 = ClusterOutput(genelist_a)
genelist_c_2 = ClusterOutput(genelist_c)

# ==== cluster Cluster_2
genelist_d = GeneList(
    Decimals=2,
    Maximum=255,
    Minimum=200,
    Value=[222.0194052, 245.7794215, 237.9362637, 212.5655189, 217.3724714, 213.3843006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])
genelist_e = GeneList(
    Decimals=2,
    Maximum=140,
    Minimum=120,
    Value=[129.7527262, 132.4599158, 124.7009477, 135.3369556, 129.2218438, 127.2149669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])
genelist_f = GeneList(
    Decimals=2,
    Maximum=90,
    Minimum=20,
    Value=[33.67383121, 65.65523303, 79.87955169, 46.57232093, 54.95017972, 40.56776494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])
panel = Panel("""21
30
18
29
18
15
15
18
18
22
25
18
18
24
24
24
29
34
23
20""")
panel_2 = Panel("""1040
650
807
348
690
653
1360
825
1000
1030
928
1185
1775
1300
538
485
330
440
309
750""")
panel_3 = Panel("""80
38
61
94
65
43
70
100
111
80
100
79
72
90
146
115
94
40
126
55""")
lng = ListLength(List=panel)
entwine = Entwine(Branch00=genelist_d, Branch01=genelist_e, Branch02=genelist_f, FlattenInputs=True)
python = GhPythonScript(x=lng)  # -> out, a; inputs x: Int32
# ---------- python: Python ----------
from datetime import datetime

a = []
for i in range(x):
    a.append(datetime.now().strftime("%Y-%m-%d %H:%M:%S"))
# ---------- end python ----------
rectangle = Rectangle(Plane=PlaneXY(0, 0, 0), XSize=panel_2, YSize=panel_3, Radius=0)  # -> Rectangle, Length
series = Series(Start=0, Step=1, Count=lng)
lng_2 = ListLength(List=panel_2)
item = ListItem(List=entwine, Index=series, Wrap=True)
series_2 = Series(Start=0, Step=Slider(171, range=0..200), Count=lng_2)
boxrec = BoxRectangle(Rectangle=rectangle.Rectangle, Height=panel)
flip = FlipMatrix(Data=item)
Y = UnitY(Factor=series_2)
move = Move(Geometry=boxrec, Motion=Y)  # -> Geometry, Transform
int = Integer(flip)
item_2 = ListItem(List=int, Index=0, Wrap=True)  # -> Item, Item1, Item2
volume = Volume(Geometry=move.Geometry)  # -> Volume, Centroid
debrep = DeconstructBrep(Brep=move.Geometry)  # -> Faces, Edges, Vertices
data = ClusterInput()
panel_4 = Panel("""1
2
3
4
5
6
7
8
9
10
11
12
13
14
15
16
17
18
19
20""")
concat = Concatenate(FragmentA=item_2.Item, FragmentB=",", FragmentC=item_2.Item1, FragmentD=",", FragmentE=item_2.Item2)  # -> flatten(Result)
linedim = LineDimension(Line=debrep.Edges, Text="{0:0.00}", Size=Slider(10, range=0..10))
data_2 = Data(data)
multiplication = Multiplication(A=panel_2, B=panel_3, C=panel)
txt = Text(panel_4)
item_3 = ListItem(List=data_2, Index=series, Wrap=True)
item_4 = ListItem(List=data_2, Index=series, Wrap=True)
tag = TextTag(Location=volume.Centroid, Text=txt, Colour="#000000")
division = Division(A=multiplication, B=1000000000)
division_2 = Division(A=item_3, B=1000)
division_3 = Division(A=division_2, B=division)
python_2 = GhPythonScript()  # -> a
# ---------- python_2: Python ----------
a = True
# ---------- end python_2 ----------
repeat = RepeatData(Reservation_name="JAVID", Length=lng)
repeat_2 = RepeatData(Requirements="1", Length=lng)
repeat_3 = RepeatData(Reserved=python_2, Length=lng)
int_2 = Integer(division_3)
repeat_4 = RepeatData(Source="Robot Lab", Length=lng)
repeat_5 = RepeatData(Price="5", Length=lng)
repeat_6 = RepeatData(Data="Hardwood", Length=lng)
repeat_7 = RepeatData(Data="Residual wood from the lab", Length=lng)
entwine_2 = Entwine(
    Branch00=panel_2,
    Branch01=panel_3,
    Branch02=panel,
    Branch03=item_4,
    Branch04=int_2,
    Branch05=python.a,
    Branch06=concat,
    Branch07=repeat_3,
    Branch08=repeat,
    Branch09=python.a,
    Branch010=repeat_2,
    Branch011=repeat_4,
    Branch012=repeat_5,
    Branch013=repeat_7,
    Branch014=repeat_6,
    FlattenInputs=True)  # -> simplify(Result)
R = ClusterOutput(entwine_2)
